# Grasshopper definition A4.gh (Grasshopper 1.0.8)

srf = Surface(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)
area = Area(Geometry=srf)  # -> Area, Centroid
scale = Scale(Geometry=srf, Center=area.Centroid, Factor=0.5)  # -> Geometry, Transform
Z = UnitZ(Factor=Slider(20, range=0..100))
number_slider = Slider(1, range=0..1)
number_slider_2 = Slider(20, range=0..1000)
number_slider_3 = Slider(10, range=0..100)
neg = Negative(Value=Z)
move = Move(Geometry=scale.Geometry, Motion=neg)  # -> Geometry, Transform
py3 = Python3Script(
    base_surface=move.Geometry,
    divU=number_slider_2,
    divV=number_slider_2,
    frequency=Slider(6, range=0..10),
    phase=Slider(5, range=0..10),
    amplitude=Slider(1, range=0..1),
    lift=Slider(0, range=0..1),
    heightmap_type=Slider(1, range=0..100),
    seed=number_slider_3)  # -> out_surface, out_points, srf_id
# ---------- py3: Python ----------
#r: numpy
import Rhino.Geometry as rg
import rhinoscriptsyntax as rs
import numpy as np
import random
import math

# ---------------------------------------------------------------------------
# INPUT CONTRACT (Grasshopper)
# ---------------------------------------------------------------------------
# Required inputs:
# - base_surface : Surface/BrepFace/Brep (if Brep, first face is used)
# - divU         : int, U subdivisions
# - divV         : int, V subdivisions
# - frequency    : float, wave frequency for heightmap
# - phase        : float, wave phase shift
# - amplitude    : float, displacement amplitude along surface normal
# - lift         : float, global Z offset after displacement
#
# Optional inputs:
# - seed            : int, random seed (for deterministic random mode)
# - heightmap_type  : int (0 = wave+bump, 1 = radial falloff + random noise)
#
# Outputs:
# - out_surface : generated displaced surface (NurbsSurface or Brep fallback)
# - out_points  : flattened displaced Point3d grid used to create the surface
# - srf_id      : compatibility output (always None in this RhinoCommon workflow)
# ---------------------------------------------------------------------------


def coerce_face_or_surface(geo):
    """Coerce GH/Rhino input into a RhinoCommon Surface/BrepFace when possible."""
    g = getattr(geo, "Geometry", geo)
    try:
        import System
        if isinstance(g, System.Guid):
            g = rs.coercesurface(g) or rs.coercebrep(g)
    except:
        pass
    if isinstance(g, rg.Brep) and g.Faces.Count > 0:
        return g.Faces[0]
    return g


def as_int(value, default, min_value=None):
    try:
        out = int(value)
    except:
        out = int(default)
    if min_value is not None and out < min_value:
        out = int(min_value)
    return out


def as_float(value, default, min_value=None):
    try:
        out = float(value)
    except:
        out = float(default)
    if min_value is not None and out < min_value:
        out = float(min_value)
    return out


def eval_point_normal(srf_obj, u, v):
    """Sample a surface point + unitized normal; fallback normal is +Z."""
    pt = srf_obj.PointAt(u, v)
    n = srf_obj.NormalAt(u, v)
    if (not n.IsValid) or n.IsZero:
        n = rg.Vector3d(0, 0, 1)
    else:
        n.Unitize()
    return pt, n


def generate_heightmap(U, V, amp, freq, phs, heightmap_type):
    """Generate a displacement field in normalized UV space."""
    un = np.linspace(0.0, 1.0, U + 1)
    vn = np.linspace(0.0, 1.0, V + 1)
    Un, Vn = np.meshgrid(un, vn, indexing="ij")

    if int(heightmap_type) == 0:
        # Structured field: sinusoidal wave blended with central bump.
        wave = np.sin((2.0 * math.pi * freq * (Un + Vn)) + phs)
        dist = np.sqrt((Un - 0.5) ** 2 + (Vn - 0.5) ** 2)
        bump = np.exp(-5.0 * dist ** 2)
        H = amp * (0.6 * wave + 0.4 * bump)
    else:
        # Stochastic field: radial falloff multiplied by random noise.
        R = np.sqrt((Un - 0.5) ** 2 + (Vn - 0.5) ** 2)
        mx = np.max(R) if np.max(R) != 0.0 else 1.0
        falloff = 1.0 - (R / mx)
        noise = (np.random.rand(*R.shape) - 0.5) * 2.0
        H = amp * falloff * noise

    return H


def build_surface_candidates(pts_grid, u_count, v_count, deg_u, deg_v):
    """Try both flattening orders when rebuilding a point-grid NurbsSurface."""
    pts_a = [pts_grid[i][j] for i in range(u_count) for j in range(v_count)]
    pts_b = [pts_grid[i][j] for j in range(v_count) for i in range(u_count)]

    srf_a = rg.NurbsSurface.CreateThroughPoints(pts_a, u_count, v_count, deg_u, deg_v, False, False)
    srf_b = rg.NurbsSurface.CreateThroughPoints(pts_b, u_count, v_count, deg_u, deg_v, False, False)
    return srf_a, pts_a, srf_b, pts_b


def loft_surface_from_grid(pts_grid, u_count, v_count, along_u=True):
    """Fallback if direct point-grid Nurbs reconstruction fails."""
    curves = []
    if along_u:
        for i in range(u_count):
            row_pts = [pts_grid[i][j] for j in range(v_count)]
            pl = rg.Polyline(row_pts)
            if pl.IsValid and pl.Count >= 2:
                curves.append(pl.ToNurbsCurve())
    else:
        for j in range(v_count):
            col_pts = [pts_grid[i][j] for i in range(u_count)]
            pl = rg.Polyline(col_pts)
            if pl.IsValid and pl.Count >= 2:
                curves.append(pl.ToNurbsCurve())

    if len(curves) < 2:
        return None

    breps = rg.Brep.CreateFromLoft(
        curves,
        rg.Point3d.Unset,
        rg.Point3d.Unset,
        rg.LoftType.Normal,
        False
    )
    if breps and len(breps) > 0 and breps[0] and breps[0].IsValid:
        return breps[0]
    return None


def first_face_surface(brep_obj):
    if brep_obj and isinstance(brep_obj, rg.Brep) and brep_obj.Faces.Count > 0:
        return brep_obj.Faces[0].ToNurbsSurface()
    return None


# ---------------------------------------------------------------------------
# INPUT NORMALIZATION
# ---------------------------------------------------------------------------
IN_base_surface = globals().get("base_surface", None)
IN_seed = globals().get("seed", None)
IN_divU = globals().get("divU", 24)
IN_divV = globals().get("divV", 24)
IN_frequency = globals().get("frequency", 1.0)
IN_phase = globals().get("phase", 0.0)
IN_amplitude = globals().get("amplitude", 1.0)
IN_lift = globals().get("lift", 0.0)
IN_heightmap_type = globals().get("heightmap_type", 0)

U = as_int(IN_divU, 24, min_value=1)
V = as_int(IN_divV, 24, min_value=1)
freq = as_float(IN_frequency, 1.0)
phs = as_float(IN_phase, 0.0)
amp = as_float(IN_amplitude, 1.0)
lift_val = as_float(IN_lift, 0.0)
heightmap_type = as_int(IN_heightmap_type, 0, min_value=0)

# Keep seed deterministic when provided.
if IN_seed is not None:
    try:
        seed_i = int(IN_seed)
        random.seed(seed_i)
        np.random.seed(seed_i)
    except:
        pass


# ---------------------------------------------------------------------------
# OUTPUTS
# ---------------------------------------------------------------------------
out_surface = None
out_points = []
srf_id = None  # Compatibility placeholder; no document object is created here.


# ---------------------------------------------------------------------------
# MAIN
# ---------------------------------------------------------------------------
srf_obj = coerce_face_or_surface(IN_base_surface)

if srf_obj is not None and isinstance(srf_obj, (rg.Surface, rg.BrepFace)):
    dom_u = srf_obj.Domain(0)
    dom_v = srf_obj.Domain(1)

    # Parameter-space sampling grid.
    u_vals = np.linspace(dom_u.T0, dom_u.T1, U + 1)
    v_vals = np.linspace(dom_v.T0, dom_v.T1, V + 1)
    Ug, Vg = np.meshgrid(u_vals, v_vals, indexing="ij")

    # Heightmap drives normal displacement.
    H = generate_heightmap(U, V, amp, freq, phs, heightmap_type)

    # Sample displaced points.
    pts_grid = [[None] * (V + 1) for _ in range(U + 1)]
    for i in range(U + 1):
        for j in range(V + 1):
            pt, n = eval_point_normal(srf_obj, float(Ug[i, j]), float(Vg[i, j]))
            p = pt + n * float(H[i, j])
            pts_grid[i][j] = rg.Point3d(float(p.X), float(p.Y), float(p.Z + lift_val))

    # Keep degrees valid for small grids.
    deg_u = 3 if (U + 1) >= 4 else max(1, U)
    deg_v = 3 if (V + 1) >= 4 else max(1, V)

    # Preferred reconstruction: direct Nurbs through points.
    srf_a, pts_a, srf_b, pts_b = build_surface_candidates(
        pts_grid, U + 1, V + 1, deg_u, deg_v
    )

    if srf_a and srf_a.IsValid:
        out_surface = srf_a
        out_points = pts_a
    elif srf_b and srf_b.IsValid:
        out_surface = srf_b
        out_points = pts_b
    else:
        # Fallback: loft across sampled rows/columns.
        loft_a = loft_surface_from_grid(pts_grid, U + 1, V + 1, along_u=True)
        loft_b = loft_surface_from_grid(pts_grid, U + 1, V + 1, along_u=False)

        if loft_a and loft_a.IsValid:
            out_surface = first_face_surface(loft_a) or loft_a
        elif loft_b and loft_b.IsValid:
            out_surface = first_face_surface(loft_b) or loft_b

        out_points = pts_a
# ---------- end py3 ----------
srf_2 = Surface(<surface referenced from the Rhino model>)
pt = Point(py3.out_points)
toggle = BooleanToggle(True)
py3_2 = Python3Script(
    reset=Button(),
    base_surface=py3.out_surface,
    seed=number_slider_3,
    max_speed=Slider(5, range=0..10),
    seed_points=py3.out_points)  # -> agents; inputs seed_points: list
# ---------- py3_2: Python ----------
import rhinoscriptsyntax as rs
import random
import numpy as np
import Rhino.Geometry as rg

# ---------------------------------------------------------------------------
# INPUT CONTRACT (Grasshopper)
# ---------------------------------------------------------------------------
# Inputs:
# - reset        : bool. Rebuilds agents when True (edge/hold behavior is handled upstream).
# - base_surface : Surface/BrepFace/Brep. If Brep, first face is used.
# - seed         : int (optional). Random/NumPy seed for repeatable initialization noise.
# - max_speed    : float. Base step size for each agent.
# - seed_points  : list[Point3d]. Initial points projected to the surface as agent starts.
#
# Outputs:
# - agents       : list[Agent] for downstream simulation.
# Notes:
# - Debug values are still stored on the component instance as:
#   self.dbg and self.seed_preview
# - If seed_points is empty, a fallback UV grid is generated from:
#   fallback_div_u, fallback_div_v (optional globals; default 8, 8).
# ---------------------------------------------------------------------------

# ---------------------------------------------------------------------------
# Utility helpers
# ---------------------------------------------------------------------------
def seed_everything(seed):
    if seed is None: return
    try: s = int(seed)
    except: return
    random.seed(s)
    np.random.seed(s)

def coerce_surface_face(base_surface):
    srf_geo = getattr(base_surface, "Geometry", base_surface)
    try:
        import System
        if isinstance(srf_geo, System.Guid):
            srf_geo = rs.coercesurface(srf_geo)
    except:
        pass
    if isinstance(srf_geo, rg.Brep) and srf_geo.Faces.Count > 0:
        srf_geo = srf_geo.Faces[0]
    return srf_geo

def iter_any(obj):
    if obj is None:
        return []
    try:
        return [x for x in obj]
    except:
        return [obj]

def to_point3d(pt):
    p = getattr(pt, "Location", pt)
    try:
        c = rs.coerce3dpoint(p)
        return rg.Point3d(c[0], c[1], c[2])
    except:
        pass
    try:
        return rg.Point3d(p.X, p.Y, p.Z)
    except:
        return None

def key3(p, prec=6):
    return (round(p.X, prec), round(p.Y, prec), round(p.Z, prec))

def key2(u, v, prec=6):
    return (round(u, prec), round(v, prec))

def as_int(value, default, min_value=None):
    try:
        out = int(value)
    except:
        out = int(default)
    if min_value is not None and out < min_value:
        out = int(min_value)
    return out

def clamp_param(t, dom):
    if t < dom.T0: return dom.T0
    if t > dom.T1: return dom.T1
    return t

def project_to_tangent(v, n):
    # v_tan = v - n*(v·n)
    return v - n * rg.Vector3d.Multiply(v, n)

# ---------------------------------------------------------------------------
# Agent definition
# ---------------------------------------------------------------------------
class Agent:
    def __init__(self, surface, uv, max_speed):
        self.surface = surface
        self.uv = rg.Point2d(uv.X, uv.Y)
        self.uv0 = rg.Point2d(uv.X, uv.Y)

        self.position = rg.Point3d(surface.PointAt(self.uv.X, self.uv.Y))
        self.velocity = rg.Vector3d(0, 0, 0)

        self.base_speed = float(max_speed)
        self.max_speed = float(max_speed)

        # behavior parameters (tune)
        self.base_spacing = 1.0
        self.curv_gain = 0.6
        self.slope_gain = 0.4
        self.sep_gain = 1.0
        self.home_gain = 0.05
        self.noise_gain = 0.02

        # modulation strengths (tune)
        self.curv_speed_k = 3.0
        self.slope_speed_k = 2.0
        self.slope_spacing_k = 0.8
        self.curv_follow_k = 1.5

        # numerics
        self.noise = 0.003
        self.eps_frac = 0.01

        # sensed values
        self.nearest_dist = None
        self.curv_dir = None
        self.curv_mag = 0.0
        self.normal = rg.Vector3d(0, 0, 1)
        self.slope_mag = 0.0
        self.downhill = rg.Vector3d(0, 0, 0)

    def sense(self, agents):
        # nearest neighbor distance only (for adaptive spacing)
        self.nearest_dist = None
        for other in agents:
            if other is self:
                continue
            d = self.position.DistanceTo(other.position)
            if self.nearest_dist is None or d < self.nearest_dist:
                self.nearest_dist = d

        # surface signals
        self.curv_dir = None
        self.curv_mag = 0.0
        self.slope_mag = 0.0
        self.downhill = rg.Vector3d(0, 0, 0)

        try:
            # normal
            n = self.surface.NormalAt(self.uv.X, self.uv.Y)
            if not n.IsZero:
                n.Unitize()
            self.normal = n

            # slope magnitude relative to world Z
            z = rg.Vector3d(0, 0, 1)
            dz = abs(rg.Vector3d.Multiply(n, z))  # |n·Z|
            self.slope_mag = 1.0 - max(0.0, min(1.0, dz))

            # curvature
            sc = self.surface.CurvatureAt(self.uv.X, self.uv.Y)
            if sc is not None:
                k0 = abs(sc.Kappa(0)); k1 = abs(sc.Kappa(1))
                d0 = sc.Direction(0); d1 = sc.Direction(1)

                # choose minimum curvature direction
                if k0 <= k1:
                    self.curv_dir = d0
                    self.curv_mag = k0
                else:
                    self.curv_dir = d1
                    self.curv_mag = k1

                if self.curv_dir is not None and self.curv_dir.Length > 1e-9:
                    self.curv_dir.Unitize()
                else:
                    self.curv_dir = None

            # downhill direction from finite-difference on height (Z)
            du = self.surface.Domain(0)
            dv = self.surface.Domain(1)
            eps_u = self.eps_frac * (du.T1 - du.T0)
            eps_v = self.eps_frac * (dv.T1 - dv.T0)

            u0 = self.uv.X
            v0 = self.uv.Y
            p = self.position

            pu = self.surface.PointAt(clamp_param(u0 + eps_u, du), v0)
            pv = self.surface.PointAt(u0, clamp_param(v0 + eps_v, dv))

            tu = rg.Vector3d(pu - p)
            tv = rg.Vector3d(pv - p)

            hu = pu.Z - p.Z
            hv = pv.Z - p.Z

            slope_vec = tu * hu + tv * hv
            downhill = -slope_vec

            downhill = project_to_tangent(downhill, n)
            if downhill.Length > 1e-9:
                downhill.Unitize()
                self.downhill = downhill
            else:
                self.downhill = rg.Vector3d(0, 0, 0)

        except:
            self.normal = rg.Vector3d(0, 0, 1)
            self.curv_dir = None
            self.curv_mag = 0.0
            self.slope_mag = 0.0
            self.downhill = rg.Vector3d(0, 0, 0)

    def decide(self, agents):
        # Modulate parameters by curvature + slope
        k = max(0.0, float(self.curv_mag))
        s = max(0.0, min(1.0, float(self.slope_mag)))

        # speed slows on high curvature and steep slope
        speed = self.base_speed / (1.0 + self.curv_speed_k * k + self.slope_speed_k * s)
        speed = max(0.001, min(self.base_speed, speed))

        # separation radius increases on steep slope (visible effect)
        R = self.base_spacing * (1.0 + self.slope_spacing_k * s)
        R = max(1e-6, R)

        # curvature-follow weight increases with curvature
        w_curv = self.curv_gain * (1.0 + self.curv_follow_k * k)
        w_slope = self.slope_gain
        w_sep = self.sep_gain
        w_home = self.home_gain
        w_noise = self.noise_gain

        # Separation force (sum over neighbors within R)
        sep = rg.Vector3d(0, 0, 0)
        for other in agents:
            if other is self:
                continue
            d = self.position.DistanceTo(other.position)
            if d <= 1e-9 or d > R:
                continue
            v = rg.Vector3d(self.position - other.position)
            if v.Length > 1e-9:
                v.Unitize()
            w = (R - d) / R
            sep += v * w

        if sep.Length > 1e-9:
            sep.Unitize()

        # Curvature flow direction (already tangent-ish, but project anyway)
        curv = rg.Vector3d(0, 0, 0)
        if self.curv_dir is not None:
            curv = rg.Vector3d(self.curv_dir)
            curv = project_to_tangent(curv, self.normal)
            if curv.Length > 1e-9:
                curv.Unitize()
            else:
                curv = rg.Vector3d(0, 0, 0)

        # Slope drift (downhill)
        slope = rg.Vector3d(self.downhill)
        if slope.Length > 1e-9:
            slope.Unitize()

        # Home spring (to original uv point on surface)
        home_pt = self.surface.PointAt(self.uv0.X, self.uv0.Y)
        home = rg.Vector3d(home_pt - self.position)
        home = project_to_tangent(home, self.normal)
        if home.Length > 1e-9:
            home.Unitize()
        else:
            home = rg.Vector3d(0, 0, 0)

        # Noise (3D, then tangent)
        noise = rg.Vector3d(
            random.uniform(-1.0, 1.0),
            random.uniform(-1.0, 1.0),
            random.uniform(-1.0, 1.0)
        )
        noise = project_to_tangent(noise, self.normal)
        if noise.Length > 1e-9:
            noise.Unitize()
        else:
            noise = rg.Vector3d(0, 0, 0)

        # Combine
        move = (sep * w_sep) + (curv * w_curv) + (slope * w_slope) + (home * w_home) + (noise * w_noise)

        # Tangent projection safety
        move = project_to_tangent(move, self.normal)

        if move.Length > 1e-9:
            move.Unitize()
        else:
            move = rg.Vector3d(0, 0, 0)

        # Store per-step step length
        self.step_len = speed
        self.move_dir = move
        self.rep_radius = R

    def move(self):
        prev = rg.Point3d(self.position)

        if not hasattr(self, "move_dir") or self.move_dir.IsZero:
            self.velocity = rg.Vector3d(0, 0, 0)
            return

        proposed = self.position + self.move_dir * self.step_len

        ok, u2, v2 = self.surface.ClosestPoint(proposed)
        if ok:
            du = self.surface.Domain(0)
            dv = self.surface.Domain(1)
            u2 = clamp_param(u2, du)
            v2 = clamp_param(v2, dv)
            self.uv = rg.Point2d(u2, v2)
            self.position = rg.Point3d(self.surface.PointAt(u2, v2))

        self.velocity = rg.Vector3d(self.position - prev)

    def update(self, agents):
        self.sense(agents)
        self.decide(agents)
        self.move()

# ---------------------------------------------------------------------------
# Agent builder from seed points
# ---------------------------------------------------------------------------
def build_agents_from_seed(surface, seed_points, max_speed):
    pts_raw = iter_any(seed_points)
    pts3 = []
    for pt in pts_raw:
        p3 = to_point3d(pt)
        if p3 is not None:
            pts3.append(p3)

    # Fallback: if no explicit seed points, seed a regular UV lattice.
    if (not pts3) and (surface is not None):
        div_u = as_int(globals().get("fallback_div_u", 8), 8, min_value=1)
        div_v = as_int(globals().get("fallback_div_v", 8), 8, min_value=1)
        du = surface.Domain(0)
        dv = surface.Domain(1)
        for i in range(div_u + 1):
            u = du.T0 + (float(i) / float(div_u)) * (du.T1 - du.T0)
            for j in range(div_v + 1):
                v = dv.T0 + (float(j) / float(div_v)) * (dv.T1 - dv.T0)
                pts3.append(surface.PointAt(u, v))

    agents = []
    uvs = []
    poss = []

    for p3 in pts3:
        ok, u, v = surface.ClosestPoint(p3)
        if not ok:
            continue
        uv = rg.Point2d(u, v)
        a = Agent(surface, uv, max_speed)
        agents.append(a)
        uvs.append(key2(u, v))
        poss.append(key3(a.position))

    dbg = "seed_raw:{0} seed_coerced:{1} agents:{2} unique_uv:{3} unique_pos:{4} unique_seed:{5}".format(
        len(pts_raw), len(pts3), len(agents),
        len(set(uvs)), len(set(poss)), len(set([key3(p) for p in pts3]))
    )
    return agents, dbg, pts3

# ---------------------------------------------------------------------------
# Grasshopper script entry
# ---------------------------------------------------------------------------
class MyComponent(Grasshopper.Kernel.GH_ScriptInstance):
    def RunScript(self,
            reset,
            base_surface,
            seed,
            max_speed,
            seed_points: list[object]):
        seed_everything(seed)
        srf = coerce_surface_face(base_surface)

        if reset or not hasattr(self, "agents") or not hasattr(self, "_inited"):
            if srf is None:
                self.agents = []
                self.dbg = "ERROR: base_surface is None or could not be coerced"
                self.seed_preview = []
            else:
                self.agents, self.dbg, self.seed_preview = build_agents_from_seed(
                    srf, seed_points, max_speed
                )
            self._inited = True

        agents = getattr(self, "agents", [])
        dbg = getattr(self, "dbg", "")
        seed_preview = getattr(self, "seed_preview", [])

        # Return tuple arity to match current GH output-port count.
        out_count = 1
        try:
            out_count = int(self.Component.Params.Output.Count)
        except:
            out_count = 1

        if out_count <= 1:
            return (agents,)
        if out_count == 2:
            return agents, dbg
        return agents, dbg, seed_preview
# ---------- end py3_2 ----------
py3_3 = Python3Script()  # -> out, a; inputs seed_points: list
# ---------- py3_3: Python ----------
import scriptcontext as sc
import Rhino.Geometry as rg

# Retrieve agents
agents = None
if x is not None and hasattr(x, "agents"):
    agents = x.agents

# Edge trigger keyed by THIS simulator instance (prevents cross-component conflicts)
k_prev = "A4_prev_step_" + str(ghenv.Component.InstanceGuid)
if k_prev not in sc.sticky:
    sc.sticky[k_prev] = False

do_step = (step is True) and (sc.sticky[k_prev] is False)
sc.sticky[k_prev] = step

# Step
if agents is not None and do_step:
    for a in agents:
        a.update(agents)

# Outputs
P = []
V = []
if agents is not None:
    for a in agents:
        # force fresh Point3d copy
        P.append(rg.Point3d(a.position))
        if a.velocity is not None and a.velocity.Length > 1e-9:
            V.append(rg.Line(a.position, a.position + a.velocity))

D = "agents:{0} stepped:{1}".format(0 if agents is None else len(agents), do_step)
# ---------- end py3_3 ----------
