# Grasshopper definition surface panelization.gh (Grasshopper 1.0.8)

number_slider = Slider(10, range=0..100)
number_slider_2 = Slider(29, range=0..30)  # disabled
number_slider_3 = Slider(3, range=0..10)  # disabled
number_slider_4 = Slider(0.6, range=0..1)  # disabled
number_slider_5 = Slider(0, range=0..100)  # disabled
number_slider_6 = Slider(1, range=0..1)  # disabled
number_slider_7 = Slider(10, range=0..10)
number_slider_8 = Slider(10, range=0..10)  # disabled
number_slider_9 = Slider(30, range=0..100)  # disabled
srf = Surface(<surface referenced from the Rhino model>)
srf_2 = Surface(<surface referenced from the Rhino model>)  # disabled
surface_generator = Python3Script(
    base_surface=srf,
    divU=number_slider,
    divV=number_slider,
    amplitude=Slider(0, range=0..100),
    frequency=Slider(3, range=0..10),
    phase=Slider(0, range=0..1),
    seed=Slider(1, range=0..1),
    lift=Slider(0, range=0..100))  # -> out_surface, out_srf_id, out_points; inputs base_surface: Surface, divU: Int32, divV: Int32, amplitude: Double, frequency: Double, phase: Double, seed: Int32, lift: Double
# ---------- surface_generator: Python ----------
#r: numpy
import Rhino.Geometry as rg
import rhinoscriptsyntax as rs
import Rhino
import numpy as np
import random
import math
import System

# ------------------------------------------------------------
# Unwrap/coerce base_surface to RhinoCommon surface/face
# ------------------------------------------------------------
srf = getattr(base_surface, "Geometry", base_surface)

if srf is None:
    out_surface = None
    out_points = []
    srf_id = None
else:
    # If Brep, take first face
    if isinstance(srf, rg.Brep):
        if srf.Faces.Count == 0:
            out_surface = None
            out_points = []
            srf_id = None
        else:
            srf = srf.Faces[0]

    if not isinstance(srf, (rg.Surface, rg.BrepFace)):
        out_surface = None
        out_points = []
        srf_id = None
    else:
        # ------------------------------------------------------------
        # Seed
        # ------------------------------------------------------------
        if seed is not None:
            random.seed(seed)
            np.random.seed(seed)

        divU = int(divU)
        divV = int(divV)

        # Need at least 4x4 points for degree-3 surfaces
        uCount = max(4, divU + 1)
        vCount = max(4, divV + 1)

        # Clamp degrees so they never violate the function contract
        deg_u = min(3, uCount - 1)
        deg_v = min(3, vCount - 1)

        # ------------------------------------------------------------
        # Normalized UV grid
        # ------------------------------------------------------------
        Uu, Vv = np.meshgrid(
            np.linspace(0.0, 1.0, uCount),
            np.linspace(0.0, 1.0, vCount),
            indexing="xy"
        )

        # ------------------------------------------------------------
        # Heightmap (wave + bump)
        # ------------------------------------------------------------
        wave = np.sin(2.0 * math.pi * float(frequency) * (Uu + Vv) + float(phase))
        cx, cy = 0.5, 0.5
        dist = np.sqrt((Uu - cx) ** 2 + (Vv - cy) ** 2)
        bump = np.exp(-5.0 * dist ** 2)
        H = float(amplitude) * (0.6 * wave + 0.4 * bump)

        # ------------------------------------------------------------
        # Map normalized UV to surface domain, sample points + normals
        # ------------------------------------------------------------
        dom_u = srf.Domain(0)
        dom_v = srf.Domain(1)

        out_points = []   # Point3d list for GH visibility/debug
        pts_for_rs = []   # tuple list for AddSrfPtGrid

        for v_i in range(vCount):
            for u_i in range(uCount):
                u = dom_u.T0 + float(Uu[v_i, u_i]) * (dom_u.T1 - dom_u.T0)
                v = dom_v.T0 + float(Vv[v_i, u_i]) * (dom_v.T1 - dom_v.T0)

                p = srf.PointAt(u, v)
                n = srf.NormalAt(u, v)
                if n.IsTiny():
                    n = rg.Vector3d(0, 0, 1)
                else:
                    n.Unitize()

                d = float(H[v_i, u_i])
                pp = rg.Point3d(
                    p.X + n.X * d,
                    p.Y + n.Y * d,
                    p.Z + n.Z * d + float(lift)
                )

                out_points.append(pp)
                pts_for_rs.append((pp.X, pp.Y, pp.Z))

        # ------------------------------------------------------------
        # Create surface using RhinoScriptSyntax (returns guid on success)
        # ------------------------------------------------------------
        srf_id = rs.AddSrfPtGrid(
            (uCount, vCount),
            pts_for_rs,
            degree=(deg_u, deg_v),
            closed=(False, False)
        )

        # ------------------------------------------------------------
        # Convert guid -> real geometry for Grasshopper preview
        # RhinoDoc.ActiveDoc.Objects.FindId(guid) returns the RhinoObject. :contentReference[oaicite:4]{index=4}
        # ------------------------------------------------------------
        out_surface = None
        if srf_id:
            # Ensure we have a System.Guid
            if isinstance(srf_id, str):
                gid = System.Guid(srf_id)
            else:
                gid = srf_id

            rh_obj = Rhino.RhinoDoc.ActiveDoc.Objects.FindId(gid)
            if rh_obj:
                # DuplicateGeometry gives GH a safe copy
                out_surface = rh_obj.Geometry.Duplicate()
# ---------- end surface_generator ----------
surface_generator_2 = Python3Script(
    base_surface=srf_2,
    divU=number_slider_9,
    divV=number_slider_9,
    amplitude=number_slider_2,
    frequency=number_slider_3,
    phase=number_slider_4,
    seed=number_slider_6,
    lift=number_slider_5)  # -> out_surface, out_srf_id, out_points; inputs base_surface: Surface, divU: Int32, divV: Int32, amplitude: Double, frequency: Double, phase: Double, seed: Int32, lift: Double; disabled; same code as surface_generator
number_slider_10 = Slider(31, range=0..100)  # disabled
pt = Point(surface_generator.out_points)
pt_2 = Point(surface_generator_2.out_points)  # disabled
srfgrid = SurfaceFromPoints(Points=pt, UCount=Slider(11, range=0..100), Interpolate=False)
srfgrid_2 = SurfaceFromPoints(Points=pt_2, UCount=number_slider_10, Interpolate=False)  # disabled
number_slider_11 = Slider(1, range=0..1)
number_slider_12 = Slider(5, range=0..10)  # disabled
panel = Panel("100")
agent_builder = Python3Script(reset=Button(), base_surface=srfgrid, seed=Slider(1, range=0..100), max_speed=Slider(6, range=0..10), seed_points=pt)  # -> x, dbg, seed_preview; inputs seed_points: list
# ---------- agent_builder: Python ----------
import rhinoscriptsyntax as rs
import random
import numpy as np
import Rhino.Geometry as rg

def seed_everything(seed):
    if seed is None: return
    try: s = int(seed)
    except: return
    random.seed(s)
    np.random.seed(s)

def coerce_surface_face(base_surface):
    srf_geo = getattr(base_surface, "Geometry", base_surface)
    try:
        import System
        if isinstance(srf_geo, System.Guid):
            srf_geo = rs.coercesurface(srf_geo)
    except:
        pass
    if isinstance(srf_geo, rg.Brep) and srf_geo.Faces.Count > 0:
        srf_geo = srf_geo.Faces[0]
    return srf_geo

def iter_any(obj):
    if obj is None:
        return []
    try:
        return [x for x in obj]
    except:
        return [obj]

def to_point3d(pt):
    p = getattr(pt, "Location", pt)
    try:
        c = rs.coerce3dpoint(p)
        return rg.Point3d(c[0], c[1], c[2])
    except:
        pass
    try:
        return rg.Point3d(p.X, p.Y, p.Z)
    except:
        return None

def key3(p, prec=6):
    return (round(p.X, prec), round(p.Y, prec), round(p.Z, prec))

def key2(u, v, prec=6):
    return (round(u, prec), round(v, prec))

def clamp_param(t, dom):
    if t < dom.T0: return dom.T0
    if t > dom.T1: return dom.T1
    return t

def project_to_tangent(v, n):
    # v_tan = v - n*(v·n)
    return v - n * rg.Vector3d.Multiply(v, n)

class Agent:
    def __init__(self, surface, uv, max_speed):
        self.surface = surface
        self.uv = rg.Point2d(uv.X, uv.Y)
        self.uv0 = rg.Point2d(uv.X, uv.Y)

        self.position = rg.Point3d(surface.PointAt(self.uv.X, self.uv.Y))
        self.velocity = rg.Vector3d(0, 0, 0)

        self.base_speed = float(max_speed)
        self.max_speed = float(max_speed)

        # behavior parameters (tune)
        self.base_spacing = 1.0
        self.curv_gain = 0.6
        self.slope_gain = 0.4
        self.sep_gain = 1.0
        self.home_gain = 0.05
        self.noise_gain = 0.02

        # modulation strengths (tune)
        self.curv_speed_k = 3.0
        self.slope_speed_k = 2.0
        self.slope_spacing_k = 0.8
        self.curv_follow_k = 1.5

        # numerics
        self.noise = 0.003
        self.eps_frac = 0.01

        # sensed values
        self.nearest_dist = None
        self.curv_dir = None
        self.curv_mag = 0.0
        self.normal = rg.Vector3d(0, 0, 1)
        self.slope_mag = 0.0
        self.downhill = rg.Vector3d(0, 0, 0)

    def sense(self, agents):
        # nearest neighbor distance only (for adaptive spacing)
        self.nearest_dist = None
        for other in agents:
            if other is self:
                continue
            d = self.position.DistanceTo(other.position)
            if self.nearest_dist is None or d < self.nearest_dist:
                self.nearest_dist = d

        # surface signals
        self.curv_dir = None
        self.curv_mag = 0.0
        self.slope_mag = 0.0
        self.downhill = rg.Vector3d(0, 0, 0)

        try:
            # normal
            n = self.surface.NormalAt(self.uv.X, self.uv.Y)
            if not n.IsZero:
                n.Unitize()
            self.normal = n

            # slope magnitude relative to world Z
            z = rg.Vector3d(0, 0, 1)
            dz = abs(rg.Vector3d.Multiply(n, z))  # |n·Z|
            self.slope_mag = 1.0 - max(0.0, min(1.0, dz))

            # curvature
            sc = self.surface.CurvatureAt(self.uv.X, self.uv.Y)
            if sc is not None:
                k0 = abs(sc.Kappa(0)); k1 = abs(sc.Kappa(1))
                d0 = sc.Direction(0); d1 = sc.Direction(1)

                # choose minimum curvature direction
                if k0 <= k1:
                    self.curv_dir = d0
                    self.curv_mag = k0
                else:
                    self.curv_dir = d1
                    self.curv_mag = k1

                if self.curv_dir is not None and self.curv_dir.Length > 1e-9:
                    self.curv_dir.Unitize()
                else:
                    self.curv_dir = None

            # downhill direction from finite-difference on height (Z)
            du = self.surface.Domain(0)
            dv = self.surface.Domain(1)
            eps_u = self.eps_frac * (du.T1 - du.T0)
            eps_v = self.eps_frac * (dv.T1 - dv.T0)

            u0 = self.uv.X
            v0 = self.uv.Y
            p = self.position

            pu = self.surface.PointAt(clamp_param(u0 + eps_u, du), v0)
            pv = self.surface.PointAt(u0, clamp_param(v0 + eps_v, dv))

            tu = rg.Vector3d(pu - p)
            tv = rg.Vector3d(pv - p)

            hu = pu.Z - p.Z
            hv = pv.Z - p.Z

            slope_vec = tu * hu + tv * hv
            downhill = -slope_vec

            downhill = project_to_tangent(downhill, n)
            if downhill.Length > 1e-9:
                downhill.Unitize()
                self.downhill = downhill
            else:
                self.downhill = rg.Vector3d(0, 0, 0)

        except:
            self.normal = rg.Vector3d(0, 0, 1)
            self.curv_dir = None
            self.curv_mag = 0.0
            self.slope_mag = 0.0
            self.downhill = rg.Vector3d(0, 0, 0)

    def decide(self, agents):
        # Modulate parameters by curvature + slope
        k = max(0.0, float(self.curv_mag))
        s = max(0.0, min(1.0, float(self.slope_mag)))

        # speed slows on high curvature and steep slope
        speed = self.base_speed / (1.0 + self.curv_speed_k * k + self.slope_speed_k * s)
        speed = max(0.001, min(self.base_speed, speed))

        # separation radius increases on steep slope (visible effect)
        R = self.base_spacing * (1.0 + self.slope_spacing_k * s)
        R = max(1e-6, R)

        # curvature-follow weight increases with curvature
        w_curv = self.curv_gain * (1.0 + self.curv_follow_k * k)
        w_slope = self.slope_gain
        w_sep = self.sep_gain
        w_home = self.home_gain
        w_noise = self.noise_gain

        # Separation force (sum over neighbors within R)
        sep = rg.Vector3d(0, 0, 0)
        for other in agents:
            if other is self:
                continue
            d = self.position.DistanceTo(other.position)
            if d <= 1e-9 or d > R:
                continue
            v = rg.Vector3d(self.position - other.position)
            if v.Length > 1e-9:
                v.Unitize()
            w = (R - d) / R
            sep += v * w

        if sep.Length > 1e-9:
            sep.Unitize()

        # Curvature flow direction (already tangent-ish, but project anyway)
        curv = rg.Vector3d(0, 0, 0)
        if self.curv_dir is not None:
            curv = rg.Vector3d(self.curv_dir)
            curv = project_to_tangent(curv, self.normal)
            if curv.Length > 1e-9:
                curv.Unitize()
            else:
                curv = rg.Vector3d(0, 0, 0)

        # Slope drift (downhill)
        slope = rg.Vector3d(self.downhill)
        if slope.Length > 1e-9:
            slope.Unitize()

        # Home spring (to original uv point on surface)
        home_pt = self.surface.PointAt(self.uv0.X, self.uv0.Y)
        home = rg.Vector3d(home_pt - self.position)
        home = project_to_tangent(home, self.normal)
        if home.Length > 1e-9:
            home.Unitize()
        else:
            home = rg.Vector3d(0, 0, 0)

        # Noise (3D, then tangent)
        noise = rg.Vector3d(
            random.uniform(-1.0, 1.0),
            random.uniform(-1.0, 1.0),
            random.uniform(-1.0, 1.0)
        )
        noise = project_to_tangent(noise, self.normal)
        if noise.Length > 1e-9:
            noise.Unitize()
        else:
            noise = rg.Vector3d(0, 0, 0)

        # Combine
        move = (sep * w_sep) + (curv * w_curv) + (slope * w_slope) + (home * w_home) + (noise * w_noise)

        # Tangent projection safety
        move = project_to_tangent(move, self.normal)

        if move.Length > 1e-9:
            move.Unitize()
        else:
            move = rg.Vector3d(0, 0, 0)

        # Store per-step step length
        self.step_len = speed
        self.move_dir = move
        self.rep_radius = R

    def move(self):
        prev = rg.Point3d(self.position)

        if not hasattr(self, "move_dir") or self.move_dir.IsZero:
            self.velocity = rg.Vector3d(0, 0, 0)
            return

        proposed = self.position + self.move_dir * self.step_len

        ok, u2, v2 = self.surface.ClosestPoint(proposed)
        if ok:
            du = self.surface.Domain(0)
            dv = self.surface.Domain(1)
            u2 = clamp_param(u2, du)
            v2 = clamp_param(v2, dv)
            self.uv = rg.Point2d(u2, v2)
            self.position = rg.Point3d(self.surface.PointAt(u2, v2))

        self.velocity = rg.Vector3d(self.position - prev)

    def update(self, agents):
        self.sense(agents)
        self.decide(agents)
        self.move()

def build_agents_from_seed(surface, seed_points, max_speed):
    pts_raw = iter_any(seed_points)
    pts3 = []
    for pt in pts_raw:
        p3 = to_point3d(pt)
        if p3 is not None:
            pts3.append(p3)

    agents = []
    uvs = []
    poss = []

    for p3 in pts3:
        ok, u, v = surface.ClosestPoint(p3)
        if not ok:
            continue
        uv = rg.Point2d(u, v)
        a = Agent(surface, uv, max_speed)
        agents.append(a)
        uvs.append(key2(u, v))
        poss.append(key3(a.position))

    dbg = "seed_raw:{0} seed_coerced:{1} agents:{2} unique_uv:{3} unique_pos:{4} unique_seed:{5}".format(
        len(pts_raw), len(pts3), len(agents),
        len(set(uvs)), len(set(poss)), len(set([key3(p) for p in pts3]))
    )
    return agents, dbg, pts3

class MyComponent(Grasshopper.Kernel.GH_ScriptInstance):
    def RunScript(self,
            reset,
            base_surface,
            seed,
            max_speed,
            seed_points: list[object]):
        seed_everything(seed)
        srf = coerce_surface_face(base_surface)

        if reset or not hasattr(self, "agents") or not hasattr(self, "_inited"):
            self.agents, self.dbg, self.seed_preview = build_agents_from_seed(
                srf, seed_points, max_speed
            )
            self._inited = True

        x = self
        dbg = getattr(self, "dbg", "")
        seed_preview = getattr(self, "seed_preview", [])
        return x, dbg, seed_preview
# ---------- end agent_builder ----------
agent_builder_2 = Python3Script(base_surface=srfgrid_2, max_speed=number_slider_12)  # -> x; disabled
# ---------- agent_builder_2: Python ----------
"""
Assignment 4: Agent-Based Model for Surface Panelization

Author: Your Name

Agent Builder Template
"""

# -----------------------------------------------------------------------------
# Imports (extend as needed)
# -----------------------------------------------------------------------------
import rhinoscriptsyntax as rs
import random
import numpy as np
import Rhino
import Rhino.Geometry as rg

# -----------------------------------------------------------------------------
# Utility functions (optional)
# -----------------------------------------------------------------------------
def seed_everything(seed):
    """Set random seeds for reproducibility."""
    if seed is None:
        return
    try:
        s = int(seed)
    except:
        return
    random.seed(s)
    np.random.seed(s)

# -----------------------------------------------------------------------------
# Core agent class
# -----------------------------------------------------------------------------
class Agent:
    """Represents a single agent with position, velocity, and state."""

    def __init__(self, position, velocity):
        """
        Initialize the agent with position and velocity.

        Public (what simulator reads):
          position: rg.Point3d
          velocity: rg.Vector3d

        Internal:
          uv: rg.Point2d
          uv_velocity: rg.Vector2d
          surface: rg.Surface or rg.BrepFace
        """
        self.position = position
        self.velocity = velocity
        self.age = 0
        self.max_speed = 0.02
        self.noise = 0.003
        self._signals = None

        self.uv = None
        self.uv_velocity = None
        self.surface = None

    def sense(self, signals):
        """Read environmental signals relevant to the agent."""
        self._signals = signals

    def decide(self):
        """Decide on actions based on sensed information."""
        # Work in UV velocity internally
        if self.uv_velocity is None:
            self.uv_velocity = rg.Vector2d(self.max_speed, 0.0)

        self.uv_velocity.X += random.uniform(-1.0, 1.0) * self.noise
        self.uv_velocity.Y += random.uniform(-1.0, 1.0) * self.noise

        sp = (self.uv_velocity.X * self.uv_velocity.X + self.uv_velocity.Y * self.uv_velocity.Y) ** 0.5
        if sp < 1e-9:
            self.uv_velocity = rg.Vector2d(self.max_speed, 0.0)
            sp = self.max_speed
        if sp > self.max_speed:
            self.uv_velocity.X = (self.uv_velocity.X / sp) * self.max_speed
            self.uv_velocity.Y = (self.uv_velocity.Y / sp) * self.max_speed

    def move(self):
        """Update position according to velocity and rules."""
        if self.surface is None or self.uv is None:
            return

        du = self.surface.Domain(0)
        dv = self.surface.Domain(1)

        # Integrate UV
        u = self.uv.X + self.uv_velocity.X
        v = self.uv.Y + self.uv_velocity.Y

        # Clamp to domain
        if u < du.T0: u = du.T0
        if u > du.T1: u = du.T1
        if v < dv.T0: v = dv.T0
        if v > dv.T1: v = dv.T1

        prev_pos = self.position

        # Update internal UV
        self.uv = rg.Point2d(u, v)

        # Update public 3D position
        self.position = self.surface.PointAt(u, v)

        # Update public 3D velocity (delta)
        self.velocity = rg.Vector3d(self.position - prev_pos)

        self.age += 1

    def update(self, agents):
        """Perform one update cycle: sense, decide, and move."""
        self.sense(None)
        self.decide()
        self.move()

# -----------------------------------------------------------------------------
# Factory for creating agents
# -----------------------------------------------------------------------------
def build_agents(num_agents, initial_data=None):
    """Create and initialize a list of Agent instances."""
    initial_data = initial_data or {}
    seed_everything(initial_data.get("seed", None))

    du0, du1 = 0.0, 1.0
    dv0, dv1 = 0.0, 1.0

    srf = initial_data.get("surface", None)
    srf_geo = None

    # Try to read real surface domain if possible
    if srf is not None:
        try:
            srf_geo = getattr(srf, "Geometry", srf)
            try:
                import System
                if isinstance(srf_geo, System.Guid):
                    srf_geo = rs.coercesurface(srf_geo)
            except:
                pass

            if isinstance(srf_geo, rg.Brep) and srf_geo.Faces.Count > 0:
                srf_geo = srf_geo.Faces[0]

            if isinstance(srf_geo, (rg.Surface, rg.BrepFace)):
                du = srf_geo.Domain(0)
                dv = srf_geo.Domain(1)
                du0, du1 = du.T0, du.T1
                dv0, dv1 = dv.T0, dv.T1
            else:
                srf_geo = None
        except:
            srf_geo = None

    max_speed = initial_data.get("max_speed", 0.02)
    try:
        max_speed = float(max_speed) if max_speed is not None else 0.02
    except:
        max_speed = 0.02

    agents = []
    for _ in range(int(num_agents)):
        u = random.uniform(du0, du1)
        v = random.uniform(dv0, dv1)

        # Initial UV velocity
        ang = random.uniform(0.0, 2.0 * np.pi)
        spd = random.uniform(0.005, max_speed)
        uv_vel = rg.Vector2d(np.cos(ang) * spd, np.sin(ang) * spd)

        # Public 3D state
        if srf_geo is not None:
            pos3d = srf_geo.PointAt(u, v)
        else:
            pos3d = rg.Point3d(u, v, 0.0)
        vel3d = rg.Vector3d(0.0, 0.0, 0.0)

        a = Agent(pos3d, vel3d)

        # Attach internal surface + UV state
        a.surface = srf_geo
        a.uv = rg.Point2d(u, v)
        a.uv_velocity = uv_vel
        a.max_speed = max_speed

        agents.append(a)

    return agents

# -----------------------------------------------------------------------------
# Grasshopper script instance (structural placeholder)
# -----------------------------------------------------------------------------
class MyComponent(Grasshopper.Kernel.GH_ScriptInstance):
    """Manages persistent agent list across Grasshopper runs."""

    def RunScript(self, N, reset, base_surface, seed, max_speed):
        """
        Main entry point called by Grasshopper.
        """
        if reset or not hasattr(self, "agents"):
            init = {"seed": seed, "surface": base_surface, "max_speed": max_speed}
            self.agents = build_agents(N, initial_data=init)
        return self
# ---------- end agent_builder_2 ----------
panel_2 = Panel(agent_builder.dbg)
agents_simulator = Python3Script(x=agent_builder_2)  # -> P, V; disabled
# ---------- agents_simulator: Python ----------
"""
Assignment 4: Agent-Based Model for Surface Panelization
Author: Your Name

Agent Simulator
"""

import rhinoscriptsyntax as rs

# -----------------------------------------------------------------------------
# Retrieve agents from upstream Grasshopper component
# -----------------------------------------------------------------------------
agents = None
if x is not None and hasattr(x, "agents"):
    agents = x.agents

# -----------------------------------------------------------------------------
# Step simulation (delegated to Agent methods)
# -----------------------------------------------------------------------------
if agents is not None:
    for agent in agents:
        agent.update(agents)

# -----------------------------------------------------------------------------
# Visualization
# -----------------------------------------------------------------------------
P = []
V = []

if agents is not None:
    for agent in agents:
        pos = agent.position
        vel = agent.velocity

        P.append(rs.AddPoint(pos.X, pos.Y, pos.Z))

        end = pos + vel
        V.append(rs.AddLine((pos.X, pos.Y, pos.Z), (end.X, end.Y, end.Z)))
# ---------- end agents_simulator ----------
agents_simulator_2 = Python3Script(x=agent_builder.x, step=Button())  # -> P, V, D
# ---------- agents_simulator_2: Python ----------
import scriptcontext as sc
import Rhino.Geometry as rg

# Retrieve agents
agents = None
if x is not None and hasattr(x, "agents"):
    agents = x.agents

# Edge trigger keyed by THIS simulator instance (prevents cross-component conflicts)
k_prev = "A4_prev_step_" + str(ghenv.Component.InstanceGuid)
if k_prev not in sc.sticky:
    sc.sticky[k_prev] = False

do_step = (step is True) and (sc.sticky[k_prev] is False)
sc.sticky[k_prev] = step

# Step
if agents is not None and do_step:
    for a in agents:
        a.update(agents)

# Outputs
P = []
V = []
if agents is not None:
    for a in agents:
        # force fresh Point3d copy
        P.append(rg.Point3d(a.position))
        if a.velocity is not None and a.velocity.Length > 1e-9:
            V.append(rg.Line(a.position, a.position + a.velocity))

D = "agents:{0} stepped:{1}".format(0 if agents is None else len(agents), do_step)
# ---------- end agents_simulator_2 ----------
pt_3 = Point(agents_simulator_2.P)
button = Button()
agents_simulator_3 = Python3Script(base_surface=srfgrid, points=pt_3, run=Toggle(True))  # -> out_mesh, out_edges, dbg; inputs base_surface: Surface, points: list of Point3d
# ---------- agents_simulator_3: Python ----------
import Rhino.Geometry as rg
import rhinoscriptsyntax as rs

# -----------------------
# Helpers: unwrap/coerce surface
# -----------------------
def coerce_face(base_surface):
    srf = getattr(base_surface, "Geometry", base_surface)

    try:
        import System
        if isinstance(srf, System.Guid):
            srf = rs.coercesurface(srf) or rs.coercebrep(srf)
    except:
        pass

    if isinstance(srf, rg.Brep):
        if srf.Faces.Count == 0:
            return None
        srf = srf.Faces[0]

    if not isinstance(srf, (rg.Surface, rg.BrepFace)):
        return None

    return srf

def as_list(x):
    if x is None:
        return []
    try:
        return list(x)
    except:
        return [x]

def clamp01(t):
    return max(0.0, min(1.0, t))

# -----------------------
# 2D Delaunay triangulation (Bowyer–Watson)
# -----------------------
def orient2d(ax, ay, bx, by, cx, cy):
    return (bx-ax)*(cy-ay) - (by-ay)*(cx-ax)

def circumcircle_contains(ax, ay, bx, by, cx, cy, px, py):
    # expects triangle abc in CCW order
    ax -= px; ay -= py
    bx -= px; by -= py
    cx -= px; cy -= py

    a2 = ax*ax + ay*ay
    b2 = bx*bx + by*by
    c2 = cx*cx + cy*cy

    det = (ax * (by*c2 - b2*cy) -
           ay * (bx*c2 - b2*cx) +
           a2 * (bx*cy - by*cx))
    return det > 1e-12

def delaunay_triangulate_2d(pts):
    n = len(pts)
    if n < 3:
        return []

    xs = [p[0] for p in pts]
    ys = [p[1] for p in pts]
    minx, maxx = min(xs), max(xs)
    miny, maxy = min(ys), max(ys)
    dx = maxx - minx
    dy = maxy - miny
    dmax = max(dx, dy)
    if dmax == 0.0:
        return []

    mx = 0.5 * (minx + maxx)
    my = 0.5 * (miny + maxy)

    # super triangle
    p0 = (mx - 20*dmax, my - dmax)
    p1 = (mx,           my + 20*dmax)
    p2 = (mx + 20*dmax, my - dmax)

    pts_ext = pts + [p0, p1, p2]
    s0, s1, s2 = n, n+1, n+2
    tris = [(s0, s1, s2)]

    for i in range(n):
        px, py = pts_ext[i]

        bad = []
        for t in tris:
            ia, ib, ic = t
            ax, ay = pts_ext[ia]
            bx, by = pts_ext[ib]
            cx, cy = pts_ext[ic]

            # For testing only: ensure CCW orientation by swapping B and C coordinates,
            # but keep the ORIGINAL triangle tuple t for removal.
            if orient2d(ax, ay, bx, by, cx, cy) < 0.0:
                bx, by, cx, cy = cx, cy, bx, by

            if circumcircle_contains(ax, ay, bx, by, cx, cy, px, py):
                bad.append(t)  # IMPORTANT: append original tuple

        # boundary edges of hole
        edge_count = {}
        def add_edge(a, b):
            if a > b:
                a, b = b, a
            edge_count[(a, b)] = edge_count.get((a, b), 0) + 1

        for (ia, ib, ic) in bad:
            add_edge(ia, ib)
            add_edge(ib, ic)
            add_edge(ic, ia)

        # remove bad triangles
        if bad:
            bad_set = set(bad)
            tris = [t for t in tris if t not in bad_set]

        boundary = [e for e, c in edge_count.items() if c == 1]

        # re-triangulate hole
        for (a, b) in boundary:
            tris.append((a, b, i))

    # remove triangles that reference super triangle vertices
    out = []
    for (a, b, c) in tris:
        if a >= n or b >= n or c >= n:
            continue
        if a == b or b == c or c == a:
            continue
        out.append((a, b, c))

    return out

# -----------------------
# Main
# -----------------------
out_mesh = None
out_edges = []
dbg = ""

if not run:
    dbg = "run is False"
else:
    srf = coerce_face(base_surface)
    pts = as_list(points)

    if srf is None:
        dbg = "ERROR: base_surface is not a Surface/BrepFace (or could not be coerced)"
    elif len(pts) < 3:
        dbg = "ERROR: need at least 3 points"
    else:
        dom_u = srf.Domain(0)
        dom_v = srf.Domain(1)
        du = float(dom_u.T1 - dom_u.T0)
        dv = float(dom_v.T1 - dom_v.T0)

        if du == 0.0 or dv == 0.0:
            dbg = "ERROR: surface domain is degenerate"
        else:
            uv_srf = []
            uv_norm = []
            bad = 0

            # project points to UV once
            for p in pts:
                p3 = rg.Point3d(p)
                ok, u, v = srf.ClosestPoint(p3)
                if not ok:
                    bad += 1
                    continue

                uv_srf.append((u, v))
                un = clamp01((u - dom_u.T0) / du)
                vn = clamp01((v - dom_v.T0) / dv)
                uv_norm.append((un, vn))

            n = len(uv_norm)
            if n < 3:
                dbg = "ERROR: <3 valid projected points (bad={})".format(bad)
            else:
                # triangulate in normalized UV
                tris = delaunay_triangulate_2d(uv_norm)

                if len(tris) == 0:
                    dbg = "ERROR: triangulation returned 0 triangles"
                else:
                    mesh = rg.Mesh()

                    # vertices on the original surface from stored UVs
                    for (u, v) in uv_srf:
                        mesh.Vertices.Add(srf.PointAt(u, v))

                    # faces
                    for (a, b, c) in tris:
                        mesh.Faces.AddFace(int(a), int(b), int(c))

                    if mesh.Faces.Count == 0:
                        dbg = "ERROR: no faces created"
                    else:
                        mesh.Normals.ComputeNormals()
                        mesh.Compact()
                        out_mesh = mesh

                        # unique edges for visualization
                        edge_set = set()
                        for f in mesh.Faces:
                            if not f.IsTriangle:
                                continue
                            A, B, C = f.A, f.B, f.C
                            for i, j in [(A, B), (B, C), (C, A)]:
                                if i > j:
                                    i, j = j, i
                                edge_set.add((i, j))

                        for i, j in edge_set:
                            out_edges.append(rg.Line(mesh.Vertices[i], mesh.Vertices[j]))

                        dbg = "OK: input:{} valid:{} bad:{} verts:{} tris:{} edges:{}".format(
                            len(pts), n, bad, mesh.Vertices.Count, mesh.Faces.Count, len(out_edges)
                        )
# ---------- end agents_simulator_3 ----------
geo = Geometry(agents_simulator_3.out_mesh)
geo_2 = Geometry(agents_simulator_3.out_edges)
panel_3 = Panel(agents_simulator_3.dbg)
